# Grasshopper definition I.gh (Grasshopper 1.0.7)

width = Slider(150, range=0..1000)
number_slider = Slider(8, range=0..10)
division = Division(A=width, B=number_slider)
sqgrid = Square(Plane=PlaneXY(0, 0, 0), Size=division, ExtentX=number_slider, ExtentY=number_slider)  # -> Cells, Points

# ---- group: 調整格子走向
tstat = TreeStatistics(Tree=sqgrid.Cells)  # -> Paths, Length, Count
dispatch = Dispatch(List=tstat.Paths, DispatchPattern=[True, False])  # -> ListA, ListB
split = SplitTree(Data=sqgrid.Cells, Masks=flatten(dispatch.ListB))  # -> reverse(Positive), Negative
merge = Merge(Data1=split.Positive, Data2=split.Negative)  # -> flatten(Result)

# ----
rec = Rectangle(merge)

# ---- group: 拆一束束
explode = Explode(Curve=rec, Recursive=True)  # -> Segments, Vertices
item = ListItem(List=explode.Segments, Index="3", Wrap=True)
range = Range(Domain=division, Steps=10)
X = UnitX(Factor=range)
move = Move(Geometry=item, Motion=X)  # -> Geometry, Transform

# ----
area = Area(Geometry=rec)  # -> Area, graft(Centroid)

# ----
# C#解法
number_slider_2 = Slider(0, range=0..360)
生角度list = CSharpScript(Rec=rec, degree=number_slider_2, rotation=Slider(90, range=0..360))  # -> out, A, B; inputs Rec: list of Rectangle3d, degree: Double, rotation: Double
# ---------- 生角度list: C# ----------
    List<double> Degree = new List<double>();
    List<Rectangle3d> Demo = new List<Rectangle3d>();

    double tmpdegree = degree;

    for(int i = 0; i < Rec.Count; i++)
    {
      if(i % 2 == 0)Degree.Add(tmpdegree);
      else
      {Degree.Add(tmpdegree += rotation);
        Demo.Add(Rec[i]);
      }

      tmpdegree = degree;
    }

    A = Degree;
    B = Demo;
# ---------- end 生角度list ----------
rotate = Rotate(Geometry=move.Geometry, Angle=graft(degrees(生角度list.A)), Plane=area.Centroid)  # -> simplify(Geometry), Transform

# ----
# 純GH解法
lng = ListLength(List=rec)
panel = Panel("""0
90""")
repeat = RepeatData(Data=panel, Length=lng)  # -> graft(Data)
rotate_2 = Rotate(Geometry=move.Geometry, Angle=degrees(repeat), Plane=area.Centroid)  # -> simplify(Geometry), Transform
