# Grasshopper definition II.gh (Grasshopper 1.0.7)

# ----
# A. SVG 檔案取樣讀點
number_slider = Slider(365, range=0..366)
# B. 讀取 CSV 檔案
number_slider_2 = Slider(1, range=0..1)
subtraction = Subtraction(A=number_slider, B=number_slider_2)
crv = Curve(<curve referenced from the Rhino model>)
divide = DivideCurve(Curve=crv, Count=subtraction, Kinks=False)  # -> Points, Tangents, Parameters
pdecon = Deconstruct(Point=divide.Points)  # -> XComponent, YComponent, ZComponent

path = FilePath("D:\3_Master\112_Fifth\TA_GH\DemoFiles\II\2023_HsinChu Cloud_365days.csv")
panel = Panel(path)
c_script = CSharpScript(csvPath=path)  # -> out, A; inputs csvPath: String
# ---------- c_script: C# usings ----------
using System.IO;
# ---------- c_script: C# ----------
    //Read the contents of the CSV files as individual lines
    string[] csvLines = System.IO.File.ReadAllLines(csvPath);

    //Check
    if(File.Exists(csvPath))Print("Successfully read file!");
    else Print("Fail to read file!");

    List < double > data = new List<double>();

    for(int i = 0; i < csvLines.Length; i++)
    {
      string rowData = csvLines[i];
      data.Add(Convert.ToDouble(rowData));
    }

    A = data;
# ---------- end c_script ----------
panel_2 = Panel(c_script.out)

width = Slider(150, range=0..1000)
number_slider_3 = Slider(8, range=0..10)
list = ValueList({"SVG": 0, "CSV": 1}, selected="CSV")
division = Division(A=width, B=number_slider_3)
sqgrid = Square(Plane=PlaneXY(0, 0, 0), Size=division, ExtentX=number_slider_3, ExtentY=number_slider_3)  # -> Cells, Points
filter = StreamFilter(Gate=list, Stream0=pdecon.YComponent, Stream1=c_script.A)

# ---- group: 調整格子走向
tstat = TreeStatistics(Tree=sqgrid.Cells)  # -> Paths, Length, Count
dispatch = Dispatch(List=tstat.Paths, DispatchPattern=[True, False])  # -> ListA, ListB
split = SplitTree(Data=sqgrid.Cells, Masks=flatten(dispatch.ListB))  # -> reverse(Positive), Negative
merge = Merge(Data1=split.Positive, Data2=split.Negative)  # -> flatten(Result)

# ---- group: 切出要的天數
number_slider_4 = Slider(40, range=0..366)
lng = ListLength(List=flatten(sqgrid.Cells))
addition = Addition(A=number_slider_4, B=lng)
subtraction_2 = Subtraction(A=addition, B="1")
dom = ConstructDomain(DomainStart=number_slider_4, DomainEnd=subtraction_2)
subset = SubList(List=filter, Domain=dom, Wrap=True)  # -> List, Index

# ---- group: 0-1 方便graph
bnd = Bounds(Numbers=subset.List)

# ----
remap = RemapNumbers(Value=subset.List, Source=bnd, Target=Domain(0, 1))  # -> Mapped, Clipped
graph = GraphMapper(
    remap.Mapped,
    x0=0,
    x1=1,
    y0=0,
    y1=1,
    container_name="Bezier",
    cpx=[0, 0.6660743952, 0.1266077161, 1],
    cpy=[0, 0.4272460938, 0.9717389345, 1])

# ----
# C#解法
number_slider_5 = Slider(0, range=0..360)
rec = Rectangle(merge)
dom_2 = ConstructDomain(DomainStart=Slider(2, range=0..10), DomainEnd=Slider(18, range=0..30))
bnd_2 = Bounds(Numbers=graph)
remap_2 = RemapNumbers(Value=graph, Source=bnd_2, Target=dom_2)  # -> Mapped, Clipped

# ---- group: 拆一束束
explode = Explode(Curve=rec, Recursive=True)  # -> Segments, Vertices
item = ListItem(List=explode.Segments, Index="3", Wrap=True)
range = Range(Domain=division, Steps=remap_2.Mapped)
X = UnitX(Factor=range)  # -> simplify(UnitVector)
move = Move(Geometry=item, Motion=X)  # -> Geometry, Transform

# ----
生角度list = CSharpScript(Rec=rec, degree=number_slider_5, rotation=Slider(90, range=0..360))  # -> out, A, B; inputs Rec: list of Rectangle3d, degree: Double, rotation: Double
# ---------- 生角度list: C# ----------
    List<double> Degree = new List<double>();
    List<Rectangle3d> Demo = new List<Rectangle3d>();

    double tmpdegree = degree;

    for(int i = 0; i < Rec.Count; i++)
    {
      if(i % 2 == 0)Degree.Add(tmpdegree);
      else
      {Degree.Add(tmpdegree += rotation);
        Demo.Add(Rec[i]);
      }

      tmpdegree = degree;
    }

    A = Degree;
    B = Demo;
# ---------- end 生角度list ----------
area = Area(Geometry=rec)  # -> Area, graft(Centroid)
viewer = ParamViewer(range)
viewer_2 = ParamViewer(X)
rotate = Rotate(Geometry=move.Geometry, Angle=graft(degrees(生角度list.A)), Plane=area.Centroid)  # -> simplify(Geometry), Transform
