# Grasshopper definition Recap_GH Data Structure.gh (Grasshopper 1.0.7)

# ---- group: 原始點
series = Series(Start=0, Step=1, Count=10)
series_2 = Series(Start=0, Step=Slider(3, range=0..10), Count="2")
pt = ConstructPoint(XCoordinate=series, YCoordinate=graft(series_2), ZCoordinate=0)

# ---- group: 拍平
flatten = FlattenTree(Tree=pt, Path="{0}")

# ----
graft = GraftTree(Tree=pt, IncludeEmptyLists=True, IncludeNullItems=True)  # -> simplify(Tree)
viewer = ParamViewer(flatten)
points = PointList(Points=flatten, Size=Slider(0.56, range=0..5))
points_2 = PointList(Points=graft, Size=Slider(0.56, range=0..5))
viewer_2 = ParamViewer(graft)
bang = ExplodeTree(Data=pt)  # -> Branch0, Branch1
viewer_3 = ParamViewer(pt)
ln = Line(StartPoint=bang.Branch0, EndPoint=bang.Branch1)
