# Grasshopper definition CustomisedCanvas.gh (Grasshopper 1.0.7)

list = ValueList({"Default": 0, "Black": 1, "White": 2, "Customised": 3}, selected="Customised")

# ---- group: 只是一個示範圖
sph = Sphere(Base=PlaneXY(0, 0, 0), Radius=Slider(15, range=0..100))
X = UnitX(Factor=Slider(45, range=0..100))
move = Move(Geometry=sph, Motion=X)  # -> Geometry, Transform

# ----
c_script = CSharpScript(val=list, colour1=ColourSwatch(SwatchColor=RGB(222, 199, 69)), colour2=ColourSwatch(SwatchColor=RGB(66, 154, 255)))  # inputs val: Int32, colour1: Color, colour2: Color
# ---------- c_script: C# usings ----------
using System.Drawing;
# ---------- c_script: C# ----------
    
    switch(val)
    {
      case 1:
        //黑底花樣
        Grasshopper.GUI.Canvas.GH_Skin.canvas_grid = Color.FromArgb(255, 0, 0, 0);
        Grasshopper.GUI.Canvas.GH_Skin.canvas_back = Color.FromArgb(255, 0, 0, 0);
        Grasshopper.GUI.Canvas.GH_Skin.canvas_edge = Color.FromArgb(150, 0, 0, 0);
        Grasshopper.GUI.Canvas.GH_Skin.canvas_shade = Color.FromArgb(80, 255, 255, 255);
        Grasshopper.GUI.Canvas.GH_Skin.wire_default = Color.FromArgb(200, 255, 255, 255);
        Grasshopper.GUI.Canvas.GH_Skin.wire_selected_a = Color.FromArgb(255, 125, 210, 40);
        Grasshopper.GUI.Canvas.GH_Skin.wire_selected_b = Color.FromArgb(50, 0, 0, 0);
        break;

      case 2:
        //白底花樣
        Grasshopper.GUI.Canvas.GH_Skin.canvas_grid = Color.FromArgb(255, 255, 255, 255);
        Grasshopper.GUI.Canvas.GH_Skin.canvas_back = Color.FromArgb(255, 255, 255, 255);
        Grasshopper.GUI.Canvas.GH_Skin.canvas_edge = Color.FromArgb(255, 255, 255, 255);
        Grasshopper.GUI.Canvas.GH_Skin.canvas_shade = Color.FromArgb(80, 255, 255, 255);
        Grasshopper.GUI.Canvas.GH_Skin.wire_default = Color.FromArgb(120, 0, 0, 0);
        Grasshopper.GUI.Canvas.GH_Skin.wire_selected_a = Color.FromArgb(255, 125, 210, 40);
        Grasshopper.GUI.Canvas.GH_Skin.wire_selected_b = Color.FromArgb(50, 0, 0, 0);
        break;

      case 3:
        //customised
        Grasshopper.GUI.Canvas.GH_Skin.canvas_grid = colour1;
        Grasshopper.GUI.Canvas.GH_Skin.canvas_back = colour1;
        Grasshopper.GUI.Canvas.GH_Skin.canvas_edge = Color.FromArgb(255, 255, 255, 255);
        Grasshopper.GUI.Canvas.GH_Skin.canvas_shade = Color.FromArgb(80, 255, 255, 255);
        Grasshopper.GUI.Canvas.GH_Skin.wire_default = colour2;
        Grasshopper.GUI.Canvas.GH_Skin.wire_selected_a = Color.FromArgb(255, 125, 210, 40);
        Grasshopper.GUI.Canvas.GH_Skin.wire_selected_b = Color.FromArgb(50, 0, 0, 0);
        break;

      default:
        //可以把剛剛上面那個預設的花樣放進來!
        Grasshopper.GUI.Canvas.GH_Skin.canvas_grid = Color.FromArgb(30, 0, 0, 0);
        Grasshopper.GUI.Canvas.GH_Skin.canvas_back = Color.FromArgb(255, 212, 208, 200);
        Grasshopper.GUI.Canvas.GH_Skin.canvas_edge = Color.FromArgb(255, 0, 0, 0);
        Grasshopper.GUI.Canvas.GH_Skin.canvas_shade = Color.FromArgb(80, 0, 0, 0);
        Grasshopper.GUI.Canvas.GH_Skin.wire_default = Color.FromArgb(150, 0, 0, 0);
        Grasshopper.GUI.Canvas.GH_Skin.wire_empty = Color.FromArgb(180, 255, 60, 0);
        Grasshopper.GUI.Canvas.GH_Skin.wire_selected_a = Color.FromArgb(255, 125, 210, 40);
        Grasshopper.GUI.Canvas.GH_Skin.wire_selected_b = Color.FromArgb(50, 0, 0, 0);
        break;
    }
# ---------- end c_script ----------
