# Grasshopper definition Side2_Practice.gh (Grasshopper 1.0.7)

練習1 = Brep(Tree({0}: [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], {1}: [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], {2}: [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], {3}: [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], {4}: [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], {5}: [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]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))
area = Area(Geometry=練習1)  # -> Area, Centroid
viewer = ParamViewer(area.Centroid)
points = PointList(Points=area.Centroid)

# ---- group: 顏色顯示區
preview = CustomPreview(Material=ColourSwatch(SwatchColor=RGB(232, 229, 216)))
preview_2 = CustomPreview(Material=ColourSwatch(SwatchColor=RGB(34, 97, 81)))
